# Dynamo graph 20190211_LG10_11_08_16_連續預力箱型樑_橋面板胸牆.dyn (Dynamo 1.2.2.373)

code_block = CodeBlock { 10; }
file_path = Filename("..\..\..\..\..\..\Civil3D_alignment\%E8%90%AC%E4%BA%8C%E7%B7%9A%E5%9E%8B\%E6%9C%80%E6%96%B0%E7%B7%9A%E5%9E%8B_20181221\%E6%A9%8B%E5%A2%A9_20190211_%E6%A0%B9%E6%93%9A%E5%BB%BA%E7%AF%89%E8%87%AA%E8%A1%8C%E6%94%B912%E7%AB%99%E9%99%84%E8%BF%91%E6%A9%8B%E5%A2%A9\LG10_11_pier.xlsx")
python_script = Python(IN[0]=file_path)
# ---------- python_script.python (31 lines) ----------
import clr

clr.AddReference('Microsoft.Office.Interop.Excel, Version=11.0.0.0, Culture=neutral, PublicKeyToken=71e9bce111e9429c')
from Microsoft.Office.Interop import Excel
from System.Runtime.InteropServices import Marshal

path = IN[0]

# Instantiate the Excel Application
ex = Excel.ApplicationClass()
# Make it Visiable for us all to see
ex.Visible = False
# Disable Alerts - Errors Ignore them, they're probably not important
ex.DisplayAlerts = False
# Workbook 
workbook = ex.Workbooks.Open(path)
# WorkSheet
ws = workbook.Worksheets[2]
# Cell range
x1range = ws.Range["A3", "G20"]
x2range = ws.Range["B1", "B4"]

r1 = x1range.Value2
r2 = x2range.Value2

OUT = r1

ex.ActiveWorkbook.Close(False)
Marshal.ReleaseComObject(ws)
Marshal.ReleaseComObject(workbook)
Marshal.ReleaseComObject(ex)
# ----------------------------------------
pierExcelReader = Custom[PierExcelReader](Pier_List=python_script)  # 讀取樁位標與參數

# group: 讀取 excel 生成上行線(North line) alignment
file_path_2 = Filename("..\..\..\..\..\..\Civil3D_alignment\%E8%90%AC%E4%BA%8C%E7%B7%9A%E5%9E%8B\%E6%9C%80%E6%96%B0%E7%B7%9A%E5%9E%8B_20181221\20190131_10_12%E6%AE%B5%E6%8F%90%E9%AB%9865%E5%85%AC%E5%88%86\LG10~LG11UP_02_%E5%88%AA%E9%99%A4%E9%BB%9E%E4%BD%8D.xlsx")
python_script_2 = Python(IN[0]=file_path_2)
# ---------- python_script_2.python (31 lines) ----------
import clr

clr.AddReference('Microsoft.Office.Interop.Excel, Version=11.0.0.0, Culture=neutral, PublicKeyToken=71e9bce111e9429c')
from Microsoft.Office.Interop import Excel
from System.Runtime.InteropServices import Marshal

path = IN[0]

# Instantiate the Excel Application
ex = Excel.ApplicationClass()
# Make it Visiable for us all to see
ex.Visible = False
# Disable Alerts - Errors Ignore them, they're probably not important
ex.DisplayAlerts = False
# Workbook 
workbook = ex.Workbooks.Open(path)
# WorkSheet
ws = workbook.Worksheets[2]
# Cell range
x1range = ws.Range["A1075", "E1658"]
x2range = ws.Range["B1", "B4"]

r1 = x1range.Value2
r2 = x2range.Value2

OUT = r1

ex.ActiveWorkbook.Close(False)
Marshal.ReleaseComObject(ws)
Marshal.ReleaseComObject(workbook)
Marshal.ReleaseComObject(ex)
# ----------------------------------------
byCoordinates = Point.ByCoordinates()  # frozen
code_block_2 = CodeBlock { 10; }
code_block_3 = CodeBlock { 1; }
takeEveryNthItem = List.TakeEveryNthItem(byCoordinates, code_block_2, code_block_3)
lastItem = List.LastItem(byCoordinates)
create = List.Create(takeEveryNthItem, lastItem)
flatten = Flatten(create)

alignmentExcelReader = Custom[AlignmentExcelReader](Alignment_List=python_script_2)

# group (continued): 讀取 excel 生成上行線(North line) alignment
code_block_4 = CodeBlock(z=alignmentExcelReader.Point_AlignmentElevation) { z-0.42; }

# group: 1為全線段生成，2為選擇線段生成，ex：1,2－生成第一及第二段
integer_slider = IntegerSlider(2, range=1..2 step 1)
integer_slider_2 = IntegerSlider(8, range=0..100 step 1)
integer_slider_3 = IntegerSlider(16, range=0..100 step 1)

code_block_5 = CodeBlock(z=alignmentExcelReader.Point_SurfaceElevation) { z-2; }
cutPointAndCurves = Custom[CutPointAndCurves](PierPoint_X=pierExcelReader.Point_X, PierPoint_Y=pierExcelReader.Point_Y, AlignmentPoint_X=alignmentExcelReader.Point_X, AlignmentPoint_Y=alignmentExcelReader.Point_Y, AlignmentPoint_Elevation=code_block_4, ModelDisplay=integer_slider, StartSection=integer_slider_2, EndSection=integer_slider_3, AlignmentPoint_SurfaceElevation=code_block_5)
count = Count(cutPointAndCurves.CutAlignment_NurbsCurve)
mul = code_block * count
code_block_6 = CodeBlock(A=mul) { 0..0..#A; }
byCoordinates_2 = Point.ByCoordinates(x=code_block_6)

# group: 讀取 excel 生成下行線(South line) alignment
byCoordinates_3 = Point.ByCoordinates()  # frozen
code_block_7 = CodeBlock { 10; }
code_block_8 = CodeBlock { 1; }
takeEveryNthItem_2 = List.TakeEveryNthItem(byCoordinates_3, code_block_7, code_block_8)
lastItem_2 = List.LastItem(byCoordinates_3)
create_2 = List.Create(takeEveryNthItem_2, lastItem_2)
flatten_2 = Flatten(create_2)
file_path_3 = Filename("..\..\..\..\..\..\Civil3D_alignment\%E8%90%AC%E4%BA%8C%E7%B7%9A%E5%9E%8B\%E6%9C%80%E6%96%B0%E7%B7%9A%E5%9E%8B_20181221\20190131_10_12%E6%AE%B5%E6%8F%90%E9%AB%9865%E5%85%AC%E5%88%86\LG10~LG11DN_02_%E5%88%AA%E9%99%A4%E9%BB%9E%E4%BD%8D.xlsx")
python_script_3 = Python(IN[0]=file_path_3)  # same code as python_script_2

code_block_9 = CodeBlock { 0.15; }
string = StringInput("width")
code_block_10 = CodeBlock { 0.15; }
string_2 = StringInput("width")
file_path_4 = Filename(".\beamDepth_22.xlsx")  # frozen
python_script_4 = Python(IN[0]=file_path_4)
# ---------- python_script_4.python (31 lines) ----------
import clr

clr.AddReference('Microsoft.Office.Interop.Excel, Version=11.0.0.0, Culture=neutral, PublicKeyToken=71e9bce111e9429c')
from Microsoft.Office.Interop import Excel
from System.Runtime.InteropServices import Marshal

path = IN[0]

# Instantiate the Excel Application
ex = Excel.ApplicationClass()
# Make it Visiable for us all to see
ex.Visible = False
# Disable Alerts - Errors Ignore them, they're probably not important
ex.DisplayAlerts = False
# Workbook 
workbook = ex.Workbooks.Open(path)
# WorkSheet
ws = workbook.Worksheets[1]
# Cell range
x1range = ws.Range["A1", "A85"]
x2range = ws.Range["B1", "B4"]

r1 = x1range.Value2
r2 = x2range.Value2

OUT = r1

ex.ActiveWorkbook.Close(False)
Marshal.ReleaseComObject(ws)
Marshal.ReleaseComObject(workbook)
Marshal.ReleaseComObject(ex)
# ----------------------------------------
count_2 = Count(python_script_4)
code_block_11 = CodeBlock(A=count_2) { 0..0..#A; }
byCoordinates_4 = Point.ByCoordinates(x=code_block_11)
doublecurvestosolid_python = Custom[DoubleCurvesToSolid_Python(VariousSection)]()  # unwired: ModelCurve, CoordinateSystem, Curve
difference = Solid.Difference(solid=doublecurvestosolid_python.Solid_01)  # unwired: other
difference_2 = Solid.Difference(solid=doublecurvestosolid_python.Solid_02)  # unwired: other
doublecurvestosolid_python_2 = Custom[DoubleCurvesToSolid_Python(VariousSection)]()  # unwired: ModelCurve, CoordinateSystem, Curve
difference_3 = Solid.Difference(solid=doublecurvestosolid_python_2.Solid_01)  # unwired: other
difference_4 = Solid.Difference(solid=doublecurvestosolid_python_2.Solid_02)  # unwired: other
create_3 = List.Create(doublecurvestosolid_python_2.Solid_01, doublecurvestosolid_python_2.Solid_02)
family_types = FamilyTypes("00_軌道道床:00_軌道道床")  # frozen
python_script_5 = Python(IN[0]=code_block, IN[1]=count)
# ---------- python_script_5.python (18 lines) ----------
import clr
clr.AddReference('ProtoGeometry')
from Autodesk.DesignScript.Geometry import *
#此節點的輸入將在 IN 變數中儲存為一個清單。
dataEnteringNode = IN

sectionNo = IN[0]
cutNo = IN[1]

out = []
for i in range(0, cutNo):
	temp = []
	for j in range(0, sectionNo):
		temp.append(0)
	out.append(temp)

#指定輸出至 OUT 變數。
OUT = out
# ----------------------------------------
byCoordinates_5 = Point.ByCoordinates(x=python_script_5)
string_3 = StringInput("angle")
code_block_12 = CodeBlock { 90; }
structureModel = Custom[StructureModel](FamilyType=family_types, Point=byCoordinates_5, parameterName01_string=string_3, parameterName01_value=code_block_12)  # 各結構模組
alignmentExcelReader_2 = Custom[AlignmentExcelReader](Alignment_List=python_script_3)

# group (continued): 讀取 excel 生成下行線(South line) alignment
code_block_13 = CodeBlock(z=alignmentExcelReader_2.Point_AlignmentElevation) { z-0.42; }

code_block_14 = CodeBlock(z=alignmentExcelReader_2.Point_SurfaceElevation) { z-2; }
cutPointAndCurves_2 = Custom[CutPointAndCurves](PierPoint_X=pierExcelReader.Point_X, PierPoint_Y=pierExcelReader.Point_Y, AlignmentPoint_X=alignmentExcelReader_2.Point_X, AlignmentPoint_Y=alignmentExcelReader_2.Point_Y, AlignmentPoint_Elevation=code_block_13, ModelDisplay=integer_slider, StartSection=integer_slider_2, EndSection=integer_slider_3, AlignmentPoint_SurfaceElevation=code_block_14)
byCoordinates_6 = Point.ByCoordinates(x=alignmentExcelReader_2.Point_X, y=alignmentExcelReader_2.Point_Y, z=code_block_13)

# group (continued): 讀取 excel 生成下行線(South line) alignment
byPoints = NurbsCurve.ByPoints(byCoordinates_6)
byJoinedCurves = PolyCurve.ByJoinedCurves(byPoints)

curvecutcoordinatesystem_python = Custom[CurveCutCoordinateSystem_Python(VariousSection)](PointStartAndEnd=cutPointAndCurves_2.PointStartAndEnd, int=code_block, Curve=byJoinedCurves)
code_block_15 = CodeBlock(Coordinatesystem=curvecutcoordinatesystem_python.CoordinateSystem) { Coordinatesystem; }
create_4 = List.Create(doublecurvestosolid_python.Solid_01, doublecurvestosolid_python.Solid_02)
byCoordinates_7 = Point.ByCoordinates(x=python_script_5)
string_4 = StringInput("angle")
code_block_16 = CodeBlock { 90; }
structureModel_2 = Custom[StructureModel](FamilyType=family_types, Point=byCoordinates_7, parameterName01_string=string_4, parameterName01_value=code_block_16)
byCoordinates_8 = Point.ByCoordinates(x=alignmentExcelReader.Point_X, y=alignmentExcelReader.Point_Y, z=code_block_4)
byPoints_2 = NurbsCurve.ByPoints(byCoordinates_8)
byJoinedCurves_2 = PolyCurve.ByJoinedCurves(byPoints_2)
curvecutcoordinatesystem_python_2 = Custom[CurveCutCoordinateSystem_Python(VariousSection)](PointStartAndEnd=cutPointAndCurves.PointStartAndEnd, int=code_block, Curve=byJoinedCurves_2)
code_block_17 = CodeBlock(coordinateSystem=curvecutcoordinatesystem_python_2.CoordinateSystem) { coordinateSystem; }
family_types_2 = FamilyTypes("02_箱型梁_上行線_胸牆:02_箱型梁_上行線_胸牆")
string_5 = StringInput("north_length")
python_script_6 = Python(IN[0]=curvecutcoordinatesystem_python_2.CutSection_Point, IN[1]=byCoordinates_6)
# ---------- python_script_6.python (26 lines) ----------
import clr
clr.AddReference('ProtoGeometry')
from Autodesk.DesignScript.Geometry import *
#此節點的輸入將在 IN 變數中儲存為一個清單。
dataEnteringNode = IN

point = IN[0]
refPoint = IN[1]

outMiniLength = []

for i in range(0, len(point)):
	miniLength = []
	for j in range(0, len(point[i])):		
		for k in range(0, len(refPoint)):
			line = Line.ByStartPointEndPoint(point[i][j],refPoint[k])
			length = line.Length
			if k == 0:
				min = length
			elif length < min:
				min = length
		miniLength.append(min/2)
	outMiniLength.append(miniLength)

#指定輸出至 OUT 變數。
OUT = outMiniLength
# ----------------------------------------
code_block_18 = CodeBlock(up_length=python_script_6) { up_length; }
structureModel_3 = Custom[StructureModel](FamilyType=family_types_2, Point=byCoordinates_7, parameterName01_string=string_5, parameterName01_value=code_block_18)
code_block_19 = CodeBlock(curve=byJoinedCurves_2) { curve; }

# group: 雙曲線模型生成
python_script_7 = Python(IN[0]=structureModel_2)
# ---------- python_script_7.python (45 lines) ----------
#Copyright(c) 2015, Konrad Sobon
# @arch_laboratory, http://archi-lab.net

import clr
clr.AddReference('ProtoGeometry')
from Autodesk.DesignScript.Geometry import *

#The inputs to this node will be stored as a list in the IN variable.
dataEnteringNode = IN

inputCurves = IN[0]

#join/group curves function
def groupCurves(Line_List): 
	ignore_distance = 0.0001 # Assume points this close or closer to each other are touching 
	Grouped_Lines = [] 
	Queue = set() 
	while Line_List: 
		Shape = [] 
		Queue.add(Line_List.pop()) # Move a line from the Line_List to our queue 
		while Queue: 
			Current_Line = Queue.pop() 
			Shape.append(Current_Line) 
			for Potential_Match in Line_List: 
				Points = (Potential_Match.StartPoint, Potential_Match.EndPoint)
				for P1 in Points: 
					for P2 in (Current_Line.StartPoint, Current_Line.EndPoint): 
						distance = P1.DistanceTo(P2) 
						if distance <= ignore_distance: 
							Queue.add(Potential_Match) 
			Line_List = [item for item in Line_List if item not in Queue]
		Grouped_Lines.append(Shape) 
	return Grouped_Lines

outputCurves = []
for i in range(0, len(inputCurves)):
	crossSplitCurves = []
	for j in range(0, len(inputCurves[i])):	
		curv = groupCurves(inputCurves[i][j])
		crossSplitCurves.append(curv)		
	outputCurves.append(crossSplitCurves)

#a = groupCurves(inputCurves)
#OUT = a
OUT = outputCurves
# ----------------------------------------
byJoinedCurves_3 = PolyCurve.ByJoinedCurves(python_script_7)
code_block_20 = CodeBlock(Coordinatesystem=code_block_17) { Coordinatesystem; }
transform = Geometry.Transform(byJoinedCurves_3, code_block_20)
code_block_21 = CodeBlock(curve=code_block_19) { curve; }
python_script_8 = Python(IN[0]=transform, IN[1]=code_block_21)  # frozen
# ---------- python_script_8.python (34 lines) ----------
import clr
clr.AddReference('ProtoGeometry')
from Autodesk.DesignScript.Geometry import *
#此節點的輸入將在 IN 變數中儲存為一個清單。
dataEnteringNode = IN

cross = IN[0]
guideCurve = IN[1]

outSolid01 = []
outSolid02 = []
for i in range(0, len(cross)):
	former = []
	latter = []
	solid01 = []
	solid02 = []
	for j in range(0, len(cross[i])):
		item01 = []
		item02 = []
		if j != len(cross[i])-1:
			item01.append(cross[i][j][0])
			item01.append(cross[i][j+1][0])
			tempSolid01 = Solid.ByLoft(item01,guideCurve)
			solid01.append(tempSolid01)
			item02.append(cross[i][j][1])
			item02.append(cross[i][j+1][1])
			tempSolid02 = Solid.ByLoft(item02,guideCurve)
			solid02.append(tempSolid02)
	outSolid01.append(solid01)
	outSolid02.append(solid02)
	

#指定輸出至 OUT 變數。
OUT = outSolid01,outSolid02
# ----------------------------------------
code_block_22 = CodeBlock(list=python_script_8) { list[0]; list[1]; }

python_script_9 = Python(IN[0]=transform)
# ---------- python_script_9.python (25 lines) ----------
import clr
clr.AddReference('ProtoGeometry')
from Autodesk.DesignScript.Geometry import *
#此節點的輸入將在 IN 變數中儲存為一個清單。
dataEnteringNode = IN

section = IN[0]

outCross01 = []
outCross02 = []
for i in range(0, len(section)):
	for j in range(0, len(section[i])-1):
		tempSec01 = []
		tempSec01.append(section[i][j][0])
		tempSec01.append(section[i][j+1][0])
		cross = Solid.ByLoft(tempSec01)
		outCross01.append(cross)
		tempSec02 = []
		tempSec02.append(section[i][j][1])
		tempSec02.append(section[i][j+1][1])
		cross = Solid.ByLoft(tempSec02)
		outCross02.append(cross)

#指定輸出至 OUT 變數。
OUT = outCross01,outCross02
# ----------------------------------------
byGeometries = ImportInstance.ByGeometries(python_script_9)
doublecurvestosolid_python_3 = Custom[DoubleCurvesToSolid_Python(VariousSection)](ModelCurve=structureModel_3, CoordinateSystem=code_block_17, Curve=code_block_19)
create_5 = List.Create(doublecurvestosolid_python_3.Solid_01, doublecurvestosolid_python_3.Solid_02)
byGeometries_2 = ImportInstance.ByGeometries(create_5)
family_types_3 = FamilyTypes("02_箱型樑_下行線_胸牆:02_箱型樑_下行線_胸牆")
string_6 = StringInput("south_length")
python_script_10 = Python(IN[0]=curvecutcoordinatesystem_python.CutSection_Point, IN[1]=byCoordinates_8)
# ---------- python_script_10.python (26 lines) ----------
import clr
clr.AddReference('ProtoGeometry')
from Autodesk.DesignScript.Geometry import *
#此節點的輸入將在 IN 變數中儲存為一個清單。
dataEnteringNode = IN

point = IN[0]
refPoint = IN[1]

outMiniLength = []

for i in range(0, len(point)):
	miniLength = []
	for j in range(0, len(point[i])):
		for k in range(0, len(refPoint)):
			line = Line.ByStartPointEndPoint(point[i][j],refPoint[k])
			length = line.Length
			if k == 0:
				min = length
			elif length < min:
				min = length
		miniLength.append(min/2)
	outMiniLength.append(miniLength)

#指定輸出至 OUT 變數。
OUT = outMiniLength
# ----------------------------------------
code_block_23 = CodeBlock(dn_length=python_script_10) { dn_length; }
structureModel_4 = Custom[StructureModel](FamilyType=family_types_3, Point=byCoordinates_5, parameterName01_string=string_6, parameterName01_value=code_block_23)
code_block_24 = CodeBlock(curve=byJoinedCurves) { curve; }

# group: 雙曲線模型生成
python_script_11 = Python(IN[0]=structureModel)  # same code as python_script_7
byJoinedCurves_4 = PolyCurve.ByJoinedCurves(python_script_11)
code_block_25 = CodeBlock(Coordinatesystem=code_block_15) { Coordinatesystem; }
transform_2 = Geometry.Transform(byJoinedCurves_4, code_block_25)
code_block_26 = CodeBlock(curve=code_block_24) { curve; }
python_script_12 = Python(IN[0]=transform_2, IN[1]=code_block_26)  # frozen; same code as python_script_8
code_block_27 = CodeBlock(list=python_script_12) { list[0]; list[1]; }

python_script_13 = Python(IN[0]=transform_2)  # same code as python_script_9
byGeometries_3 = ImportInstance.ByGeometries(python_script_13)
doublecurvestosolid_python_4 = Custom[DoubleCurvesToSolid_Python(VariousSection)](ModelCurve=structureModel_4, CoordinateSystem=code_block_15, Curve=code_block_24)
create_6 = List.Create(doublecurvestosolid_python_4.Solid_01, doublecurvestosolid_python_4.Solid_02)
byGeometries_4 = ImportInstance.ByGeometries(create_6)
family_types_4 = FamilyTypes("02_箱型梁_上行線_橋面板:02_箱型梁_上行線_橋面板")
structureModel_5 = Custom[StructureModel](FamilyType=family_types_4, Point=byCoordinates_7, parameterName01_string=string_5, parameterName01_value=code_block_18)
singlecurvetosolid_python = Custom[SingleCurveToSolid_Python(VariousSection)](ModelCurve=structureModel_5, CoordinateSystem=code_block_17, Curve=code_block_19)
byGeometries_5 = ImportInstance.ByGeometries(singlecurvetosolid_python)
family_types_5 = FamilyTypes("00_鋼箱樑:00_鋼箱樑")  # frozen
string_7 = StringInput("beamDepth")
code_block_28 = CodeBlock { 2; }
structureModel_6 = Custom[StructureModel](FamilyType=family_types_5, Point=byCoordinates_7, parameterName01_string=string_7, parameterName01_value=code_block_28)
doublecurvestosolid_python_5 = Custom[DoubleCurvesToSolid_Python(VariousSection)](ModelCurve=structureModel_6, CoordinateSystem=code_block_17, Curve=code_block_19)  # frozen
difference_5 = Solid.Difference(solid=doublecurvestosolid_python_5.Solid_02, other=doublecurvestosolid_python_5.Solid_01)
byGeometries_6 = ImportInstance.ByGeometries(difference_5)
family_types_6 = FamilyTypes("00_電纜溝槽_上行線:00_電纜溝槽_上行線")  # frozen
structureModel_7 = Custom[StructureModel](FamilyType=family_types_6, Point=byCoordinates_7, parameterName01_string=string_5, parameterName01_value=code_block_18)
doublecurvestosolid_python_6 = Custom[DoubleCurvesToSolid_Python(VariousSection)](ModelCurve=structureModel_7, CoordinateSystem=code_block_17, Curve=code_block_19)
difference_6 = Solid.Difference(solid=doublecurvestosolid_python_6.Solid_02, other=doublecurvestosolid_python_6.Solid_01)
byGeometries_7 = ImportInstance.ByGeometries(difference_6)
family_types_7 = FamilyTypes("00_電纜溝槽_下行線:00_電纜溝槽_下行線")  # frozen
structureModel_8 = Custom[StructureModel](FamilyType=family_types_7, Point=byCoordinates_5, parameterName01_string=string_6, parameterName01_value=code_block_23)
doublecurvestosolid_python_7 = Custom[DoubleCurvesToSolid_Python(VariousSection)](ModelCurve=structureModel_8, CoordinateSystem=code_block_15, Curve=code_block_24)
difference_7 = Solid.Difference(solid=doublecurvestosolid_python_7.Solid_02, other=doublecurvestosolid_python_7.Solid_01)
byGeometries_8 = ImportInstance.ByGeometries(difference_7)
family_types_8 = FamilyTypes("02_箱型樑_下行線_橋面板:02_箱型樑_下行線_橋面板")
structureModel_9 = Custom[StructureModel](FamilyType=family_types_8, Point=byCoordinates_5, parameterName01_string=string_6, parameterName01_value=code_block_23)
singlecurvetosolid_python_2 = Custom[SingleCurveToSolid_Python(VariousSection)](ModelCurve=structureModel_9, CoordinateSystem=code_block_15, Curve=code_block_24)
byGeometries_9 = ImportInstance.ByGeometries(singlecurvetosolid_python_2)
family_types_9 = FamilyTypes("00_鋼箱樑:00_鋼箱樑")  # frozen
string_8 = StringInput("beamDepth")
code_block_29 = CodeBlock { 2; }
structureModel_10 = Custom[StructureModel](FamilyType=family_types_9, Point=byCoordinates_7, parameterName01_string=string_8, parameterName01_value=code_block_29)
doublecurvestosolid_python_8 = Custom[DoubleCurvesToSolid_Python(VariousSection)](ModelCurve=structureModel_10, CoordinateSystem=code_block_15, Curve=code_block_24)
difference_8 = Solid.Difference(solid=doublecurvestosolid_python_8.Solid_02, other=doublecurvestosolid_python_8.Solid_01)
byGeometries_10 = ImportInstance.ByGeometries(difference_8)
categories = Categories("GenericModel")
string_9 = StringInput("U型樑01")
byGeometry = DirectShape.ByGeometry(category=categories, name=string_9)  # unwired: geometry
string_10 = StringInput("彩現材料128-255-0")
string_11 = StringInput("預設牆")
file_path_5 = Filename("..\Pier_Revised.xlsx")
string_12 = StringInput("LG10_11")
code_block_30 = CodeBlock(sheetName=string_12) { sheetName; }
code_block_31 = CodeBlock { 0; 0; }
create_7 = List.Create(cutPointAndCurves.Pier_Alignment_distance, cutPointAndCurves_2.Pier_Alignment_distance)
transpose = List.Transpose(create_7)
boolean = BoolSelector(false)
writeToFile = Excel.WriteToFile(filePath=file_path_5, sheetName=code_block_30, startRow=code_block_31.out0, startCol=code_block_31.out1, data=transpose, overWrite=boolean)  # frozen
python_script_14 = Python(IN[0]=curvecutcoordinatesystem_python_2.CutSection_Point, IN[1]=byCoordinates_6)
# ---------- python_script_14.python (26 lines) ----------
import clr
clr.AddReference('ProtoGeometry')
from Autodesk.DesignScript.Geometry import *
#此節點的輸入將在 IN 變數中儲存為一個清單。
dataEnteringNode = IN

point = IN[0]
refPoint = IN[1]

outMiniLength = []

for i in range(0, len(point)):
	miniLength = []
	for j in range(0, len(point[i])):		
		for k in range(0, len(refPoint)):
			line = Line.ByStartPointEndPoint(point[i][j],refPoint[k])
			length = line.Length
			if k == 0:
				min = length
			elif length < min:
				min = length
		miniLength.append(min)
	outMiniLength.append(miniLength)

#指定輸出至 OUT 變數。
OUT = outMiniLength
# ----------------------------------------
code_block_32 = CodeBlock(z=python_script_14) { z-2.03-2.02; }
family_types_10 = FamilyTypes()
code_block_33 = CodeBlock(curve=byJoinedCurves_2) { curve; }
boolean_2 = BoolSelector(false)
code_block_34 = CodeBlock(start=integer_slider_2, end=integer_slider_3) { start; end; }  # frozen
pier_Plane_CS_SurfaceEle = Custom[Pier_Plane_CS_SurfaceEle](curve=code_block_33, Pier_Alignment_Point=cutPointAndCurves.Pier_Alignment_Point, ModelDisplay=boolean_2, Start=code_block_34.start, End=code_block_34.end, PierSurface_Elevation=cutPointAndCurves.PierSurface_Elevation)  # 墩柱切線型平面、座標系統、地表高程
family_types_11 = FamilyTypes("00_鋼箱樑:00_鋼箱樑")
string_13 = StringInput("beamDepth")
code_block_35 = CodeBlock { 2; }
python_script_15 = Python(IN[0]=pierExcelReader.Point_X, IN[1]=pierExcelReader.Point_Y, IN[2]=boolean_2, IN[3]=code_block_34.start, IN[4]=code_block_34.end)
# ---------- python_script_15.python (24 lines) ----------
import clr
clr.AddReference('ProtoGeometry')
from Autodesk.DesignScript.Geometry import *
#此節點的輸入將在 IN 變數中儲存為一個清單。
dataEnteringNode = IN

pointX = IN[0]
pointY = IN[1]
check = IN[2]
start = IN[3]
end = IN[4]

outX = []
outY = []
if check:
	outX.append(pointX)
	outY.append(pointY)
else:
	for i in range(start-1, end):
		outX.append(pointX[i])
		outY.append(pointY[i])

#指定輸出至 OUT 變數。
OUT = outX, outY
# ----------------------------------------
code_block_36 = CodeBlock(X=python_script_15, Y=python_script_15) { X[0]; Y[1]; }
alignment_elevation = Custom[Alignment_elevation](CoordinateSystem=curvecutcoordinatesystem_python_2.CoordinateSystem, Pier_Alignment_Plane=pier_Plane_CS_SurfaceEle.Pier_Alignment_Plane, FamilyType=family_types_11, ParameterName_string=string_13, ParameterName_value=code_block_35, X=code_block_36.out0, Y=code_block_36.out1, PierSurface_Elevation=pier_Plane_CS_SurfaceEle.PierSurface_Elevation)  # 上下行線的高程計算
code_block_37 = CodeBlock(familytype_point=alignment_elevation.Family_Point) { familytype_point; }
byPoint = FamilyInstance.ByPoint(familyType=family_types_10, point=code_block_37)
string_14 = StringInput("備註")
code_block_38 = CodeBlock(start=code_block_34.start, end=code_block_34.end) { start; end; }
string_15 = StringInput("_")
code_block_39 = CodeBlock(sectionName=string_12) { sectionName; }
string_16 = StringInput("基樁")
join = String.Join(string_15, code_block_39, string_16)
python_script_16 = Python(IN[0]=code_block_38.start, IN[1]=code_block_38.end, IN[2]=join)
# ---------- python_script_16.python (19 lines) ----------
import clr
clr.AddReference('ProtoGeometry')
from Autodesk.DesignScript.Geometry import *
#此節點的輸入將在 IN 變數中儲存為一個清單。
dataEnteringNode = IN

pierStart = IN[0]
pierEnd = IN[1]
name = IN[2]

out = []
for i in range(pierStart, pierEnd+1):
	if i < 10:
		out.append(name + "0" + repr(i))
	else:
		out.append(name + repr(i))

#指定輸出至 OUT 變數。
OUT = out
# ----------------------------------------
setParameterByName = Element.SetParameterByName(element=byPoint, parameterName=string_14, value=python_script_16)
normal = Plane.Normal(pier_Plane_CS_SurfaceEle.Pier_Alignment_Plane)
YAxis = Vector.YAxis()
angleWithVector = Vector.AngleWithVector(vector=normal, otherVector=YAxis)
python_script_17 = Python(IN[0]=normal, IN[1]=angleWithVector)
# ---------- python_script_17.python (18 lines) ----------
import clr
clr.AddReference('ProtoGeometry')
from Autodesk.DesignScript.Geometry import *
#此節點的輸入將在 IN 變數中儲存為一個清單。
dataEnteringNode = IN

vector = IN[0]
angle = IN[1]

outAngle = []
for i in range(0, len(vector)):
	if vector[i].X > 0:
		outAngle.append(angle[i])
	else:
		outAngle.append(angle[i]*(-1))

#指定輸出至 OUT 變數。
OUT = outAngle
# ----------------------------------------
setRotation = FamilyInstance.SetRotation(familyInstance=setParameterByName, degree=python_script_17)
family_types_12 = FamilyTypes()
byPoint_2 = FamilyInstance.ByPoint(familyType=family_types_12, point=code_block_37)
string_17 = StringInput("基礎")
join_2 = String.Join(string_15, code_block_39, string_17)
python_script_18 = Python(IN[0]=code_block_38.start, IN[1]=code_block_38.end, IN[2]=join_2)  # same code as python_script_16
setParameterByName_2 = Element.SetParameterByName(element=byPoint_2, parameterName=string_14, value=python_script_18)
setRotation_2 = FamilyInstance.SetRotation(familyInstance=setParameterByName_2, degree=python_script_17)
family_types_13 = FamilyTypes()
byPoint_3 = FamilyInstance.ByPoint(familyType=family_types_13, point=code_block_37)
string_18 = StringInput("上行墩柱")
join_3 = String.Join(string_15, code_block_39, string_18)
python_script_19 = Python(IN[0]=code_block_38.start, IN[1]=code_block_38.end, IN[2]=join_3)  # same code as python_script_16
setParameterByName_3 = Element.SetParameterByName(element=byPoint_3, parameterName=string_14, value=python_script_19)
string_19 = StringInput("pier_height_up")
code_block_40 = CodeBlock(z=alignment_elevation.Alignment_Elevation) { z-0.1; }
setParameterByName_4 = Element.SetParameterByName(element=setParameterByName_3, parameterName=string_19, value=code_block_40)
setRotation_3 = FamilyInstance.SetRotation(familyInstance=setParameterByName_4, degree=python_script_17)
family_types_14 = FamilyTypes()
byPoint_4 = FamilyInstance.ByPoint(familyType=family_types_14, point=alignment_elevation.Family_Point)
string_20 = StringInput("上行帽樑")
join_4 = String.Join(string_15, code_block_39, string_20)
python_script_20 = Python(IN[0]=code_block_38.start, IN[1]=code_block_38.end, IN[2]=join_4)  # same code as python_script_16
setParameterByName_5 = Element.SetParameterByName(element=byPoint_4, parameterName=string_14, value=python_script_20)
setParameterByName_6 = Element.SetParameterByName(element=setParameterByName_5, parameterName=string_19, value=code_block_40)
string_21 = StringInput("bearing_UP")
python_script_21 = Python(IN[0]=pierExcelReader.Point_X, IN[1]=pierExcelReader.Point_Y, IN[2]=pierExcelReader.Point_X2, IN[3]=pierExcelReader.Point_Y2, IN[4]=boolean_2, IN[5]=code_block_34.start, IN[6]=code_block_34.end, IN[7]=cutPointAndCurves.Pier_Alignment_distance, IN[8]=cutPointAndCurves_2.Pier_Alignment_distance)
# ---------- python_script_21.python (33 lines) ----------
import clr
import math
clr.AddReference('ProtoGeometry')
from Autodesk.DesignScript.Geometry import *
#此節點的輸入將在 IN 變數中儲存為一個清單。
dataEnteringNode = IN

pointX1 = IN[0]
pointY1 = IN[1]
pointX2 = IN[2]
pointY2 = IN[3]
check = IN[4]
start = IN[5]
end = IN[6]
distanceUP = IN[7]
distanceDN = IN[8]

outLength = []
outUP = []
outDN = []
if check == False:
	for i in range(start-1, end):
		X1 = float(pointX1[i])
		X2 = float(pointX2[i])
		Y1 = float(pointY1[i])
		Y2 = float(pointY2[i])
		length = math.sqrt((X1 - X2) ** 2 + (Y1 - Y2) ** 2)
		outLength.append(length)
		outUP.append(distanceUP[i])
		outDN.append(distanceDN[i])

#指定輸出至 OUT 變數。
OUT = outLength, outUP, outDN
# ----------------------------------------
code_block_41 = CodeBlock(column_distance=python_script_21, pier_UP_distance=python_script_21, pier_DN_distance=python_script_21) { column_distance[0]; pier_UP_distance[1]; pier_DN_distance[2]; }
setParameterByName_7 = Element.SetParameterByName(element=setParameterByName_6, parameterName=string_21, value=code_block_41.out1)
string_22 = StringInput("bearing_DN")
setParameterByName_8 = Element.SetParameterByName(element=setParameterByName_7, parameterName=string_22, value=code_block_41.out2)
setRotation_4 = FamilyInstance.SetRotation(familyInstance=setParameterByName_8, degree=python_script_17)
string_23 = StringInput("column_distance")  # frozen
setParameterByName_9 = Element.SetParameterByName(element=setParameterByName_6, parameterName=string_23, value=code_block_41.out0)
setParameterByName_10 = Element.SetParameterByName(element=setParameterByName_4, parameterName=string_23, value=code_block_41.out0)
setParameterByName_11 = Element.SetParameterByName(element=setParameterByName_2, parameterName=string_23, value=code_block_41.out0)
setParameterByName_12 = Element.SetParameterByName(element=setParameterByName, parameterName=string_23, value=code_block_41.out0)
code_block_42 = CodeBlock { 0.752; 0.4151; }  # frozen
byCartesianCoordinates = Point.ByCartesianCoordinates(curvecutcoordinatesystem_python_2.CoordinateSystem, code_block_42.out0, arg3=code_block_42.out1)
code_block_43 = CodeBlock { 1; }
byCartesianCoordinates_2 = Point.ByCartesianCoordinates(curvecutcoordinatesystem_python_2.CoordinateSystem, code_block_42.out0, code_block_43, code_block_42.out1)
X = Point.X(byCartesianCoordinates_2)
Y = Point.Y(byCartesianCoordinates_2)
Z = Point.Z(byCartesianCoordinates)
byCoordinates_9 = Point.ByCoordinates(x=X, y=Y, z=Z)
python_script_22 = Python(IN[0]=byCartesianCoordinates, IN[1]=byCoordinates_9)
# ---------- python_script_22.python (19 lines) ----------
import clr
clr.AddReference('ProtoGeometry')
from Autodesk.DesignScript.Geometry import *
#此節點的輸入將在 IN 變數中儲存為一個清單。
dataEnteringNode = IN

point = IN[0]
insertPoint = IN[1]

outPoint = []
for i in range(0, len(point)):
	tempPoint = []
	for j in range(0, len(point[i])):
		tempPoint.append(point[i][j])
		tempPoint.append(insertPoint[i][j])
	outPoint.append(tempPoint)

#指定輸出至 OUT 變數。
OUT = outPoint
# ----------------------------------------
family_types_15 = FamilyTypes("00_軌道道床:00_軌道道床")
byPoints_3 = AdaptiveComponent.ByPoints(points=python_script_22, familyType=family_types_15)
curvecutcoordinatesystem_python_3 = Custom[CurveCutCoordinateSystem_Python(VariousSection)](PointStartAndEnd=cutPointAndCurves.PointStartAndEnd, int=count_2, Curve=byJoinedCurves_2)
code_block_44 = CodeBlock { 2.4; }
code_block_45 = CodeBlock(x=code_block_42.out0) { -x; }
byCartesianCoordinates_3 = Point.ByCartesianCoordinates(curvecutcoordinatesystem_python_2.CoordinateSystem, code_block_45, arg3=code_block_42.out1)
byCartesianCoordinates_4 = Point.ByCartesianCoordinates(curvecutcoordinatesystem_python_2.CoordinateSystem, code_block_45, code_block_43, code_block_42.out1)
X_2 = Point.X(byCartesianCoordinates_4)
Y_2 = Point.Y(byCartesianCoordinates_4)
Z_2 = Point.Z(byCartesianCoordinates_3)
byCoordinates_10 = Point.ByCoordinates(x=X_2, y=Y_2, z=Z_2)
python_script_23 = Python(IN[0]=byCartesianCoordinates_3, IN[1]=byCoordinates_10)  # same code as python_script_22
family_types_16 = FamilyTypes("00_軌道道床:00_軌道道床")
byPoints_4 = AdaptiveComponent.ByPoints(points=python_script_23, familyType=family_types_16)
code_block_46 = CodeBlock(pier_height=code_block_40, bearing_height=code_block_35) { pier_height + 4.1; bearing_height; }
family_types_17 = FamilyTypes()
byPoint_5 = FamilyInstance.ByPoint(familyType=family_types_17, point=code_block_37)
string_24 = StringInput("下行墩柱")
join_5 = String.Join(string_15, code_block_39, string_24)
python_script_24 = Python(IN[0]=code_block_38.start, IN[1]=code_block_38.end, IN[2]=join_5)  # same code as python_script_16
setParameterByName_13 = Element.SetParameterByName(element=byPoint_5, parameterName=string_14, value=python_script_24)
string_25 = StringInput("pier_height_dn")
code_block_47 = CodeBlock(curve=byJoinedCurves) { curve; }
pier_Plane_CS_SurfaceEle_2 = Custom[Pier_Plane_CS_SurfaceEle](curve=code_block_47, Pier_Alignment_Point=cutPointAndCurves_2.Pier_Alignment_Point, ModelDisplay=boolean_2, Start=code_block_34.start, End=code_block_34.end, PierSurface_Elevation=cutPointAndCurves_2.PierSurface_Elevation)
alignment_elevation_2 = Custom[Alignment_elevation](CoordinateSystem=curvecutcoordinatesystem_python.CoordinateSystem, Pier_Alignment_Plane=pier_Plane_CS_SurfaceEle_2.Pier_Alignment_Plane, FamilyType=family_types_11, ParameterName_string=string_13, ParameterName_value=code_block_35, X=code_block_36.out0, Y=code_block_36.out1, PierSurface_Elevation=pier_Plane_CS_SurfaceEle.PierSurface_Elevation)
code_block_48 = CodeBlock(z=alignment_elevation_2.Alignment_Elevation) { z-0.1; }
setParameterByName_14 = Element.SetParameterByName(element=setParameterByName_13, parameterName=string_25, value=code_block_48)
setRotation_5 = FamilyInstance.SetRotation(familyInstance=setParameterByName_14, degree=python_script_17)
setParameterByName_15 = Element.SetParameterByName(element=setParameterByName_13, parameterName=string_19, value=code_block_40)
family_types_18 = FamilyTypes()
byPoint_6 = FamilyInstance.ByPoint(familyType=family_types_18, point=code_block_37)
string_26 = StringInput("下行帽樑")
join_6 = String.Join(string_15, code_block_39, string_26)
python_script_25 = Python(IN[0]=code_block_38.start, IN[1]=code_block_38.end, IN[2]=join_6)  # same code as python_script_16
setParameterByName_16 = Element.SetParameterByName(element=byPoint_6, parameterName=string_14, value=python_script_25)
setParameterByName_17 = Element.SetParameterByName(element=setParameterByName_16, parameterName=string_19, value=code_block_40)
setParameterByName_18 = Element.SetParameterByName(element=setParameterByName_16, parameterName=string_25, value=code_block_48)
setParameterByName_19 = Element.SetParameterByName(element=setParameterByName_18, parameterName=string_21, value=code_block_41.out1)
setParameterByName_20 = Element.SetParameterByName(element=setParameterByName_19, parameterName=string_22, value=code_block_41.out2)
setRotation_6 = FamilyInstance.SetRotation(familyInstance=setParameterByName_20, degree=python_script_17)
